# Grasshopper definition S15_Grid_To_Map.ghx (Grasshopper 1.0.9)

path = FilePath("/Users/ella/Documents/ARCH 6131/2026/class 9/lots_grid.csv")
file = ReadFile(File=path, PerLineParse=True)
split = SplitList(List=file, Index="1")  # -> ListA, ListB
split_2 = TextSplit(Text=split.ListA, Separators=",")
split_3 = TextSplit(Text=split.ListB, Separators=",")  # -> simplify(Result)
panel = Panel(split_2)
panel_2 = Panel(split_3)
flip = FlipMatrix(Data=split_3)
bang = ExplodeTree(Data=flip)  # -> Branch0, Branch1, Branch2, Branch3, Branch4, Branch5, Branch6, Branch7, Branch8
number_slider = Slider(0.25, range=0..1)
bbl = Text(bang.Branch0)
avg_height = Number(bang.Branch2)
coverage_pct = Number(bang.Branch5)
anchor_y = Number(bang.Branch8)
anchor_x = Number(bang.Branch7)
bnd = Bounds(Numbers=avg_height)
bnd_2 = Bounds(Numbers=coverage_pct)
dedomain = DeconstructDomain(Domain=bnd)  # -> Start, End
dedomain_2 = DeconstructDomain(Domain=bnd_2)  # -> Start, End
dom = ConstructDomain(DomainStart="0", DomainEnd=dedomain.End)
dom_2 = ConstructDomain(DomainStart="0", DomainEnd=dedomain_2.End)
m_objects = QueryModelObjects(Layer="map_anchors", Locked=True, Hidden=True, Selected=False, AutoUpdateState=True)
panel_3 = Panel(m_objects)

bar_height = Slider(5034, range=0..100000)
bar_width = Slider(176, range=0..1000)
text_size = Slider(878, range=0..1000)

bar_height_2 = Slider(671, range=0..50000)
gap = Slider(557, range=0..1000)
object = ModelObject(Object=m_objects)  # -> Object, Geometry, Name, Layer, Visibility, Display, Drafting, Section, Render
remap = RemapNumbers(Value=avg_height, Source=dom, Target=bar_height)  # -> Mapped, Clipped
starting_point_avg_height = ConstructPoint(XCoordinate=anchor_x, YCoordinate=anchor_y, ZCoordinate=0)
expression = Expression(gap=gap, x=anchor_x, Expression="x+gap")
remap_2 = RemapNumbers(Value=coverage_pct, Source=dom_2, Target=bar_height_2)  # -> Mapped, Clipped
panel_4 = Panel(object.Name)
panel_5 = Panel(object.Geometry)
starting_point_text = ConstructPoint(XCoordinate=expression, YCoordinate=anchor_y, ZCoordinate=0)
starting_point_coverage_pct = ConstructPoint(XCoordinate=expression, YCoordinate=anchor_y, ZCoordinate=0)
panel_6 = Panel(remap_2.Mapped)
mindex = MemberIndex(Set=object.Name, Member=bbl)  # -> Index, Count
basey = Expression(ts=text_size, y=anchor_y, H=bar_height, Expression="y - ts*2 - H")
panel_7 = Panel(remap.Mapped)
item = ListItem(List=object.Geometry, Index=mindex.Index, Wrap=True)  # -> flatten(Item)
panel_8 = Panel(mindex.Index)
text_siize = Slider(123, range=0..500)
ln = Line(StartPoint=starting_point_text, EndPoint=item)
tag = TextTag3D(Location=starting_point_text, Text=bbl, Size=text_siize, Justification=7)
panel_9 = Panel(mindex.Count)
rectangle = Rectangle(Plane=starting_point_avg_height, XSize=bar_width, YSize=panel_6, Radius=0)  # -> Rectangle, Length
rectangle_2 = Rectangle(Plane=starting_point_coverage_pct, XSize=bar_width, YSize=panel_7, Radius=0)  # -> Rectangle, Length
